% Simulink data dictionary RoverDataDict.sldd
% references MiL_DataDict.sldd
% references SiL_DataDict.sldd
% references Environment_DataDict.sldd
% references ATRover_AutosarDataDictionary.sldd

DAQ_In = Simulink.Bus()
  Sensor_Back_Left: double, Unit="V"
  Sensor_Back_Center: double, Unit="V"
  Sensor_Back_Right: double, Unit="V"
  Sensor_Front_Left: double, Unit="V"
  Sensor_Front_Center: double, Unit="V"
  Sensor_Front_Right: double, Unit="V"
  Drive_Direction: double, Unit="V"
  Turn_Direction: double, Unit="V"

Config_Test = Simulink.ConfigSet(StartTime="0", StopTime="60", RelTol="1e-3", Solver="VariableStepAuto", ProdHWDeviceType="Intel->x86-64 (Windows64)", SystemTargetFile="grt.tlc", TargetLang="C")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

Obstacle_Detection_Out = Simulink.Bus()
  Load_Center: double
  Load_Side: double
  Load_Opposite: double
  Target_Steering: double
  Target_Driving: double

ConfigSet_Slave = Simulink.ConfigSet(StartTime="0", StopTime="10", Solver="FixedStepDiscrete", ProdHWDeviceType="Intel->x86-64 (Windows64)", SystemTargetFile="autosar.tlc", TargetLang="C")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